# Grasshopper definition example.gh (Grasshopper 1.0.7)
# plug-ins: Kangaroo2 Components, Weaverbird, MeshQuadrangulation

conmesh = ConstructMesh(Vertices=[Point(0, 0, 0), Point(10, 0, 0), Point(10, 10, 0), Point(0, 10, 0)], Faces={A=0, B=1, C=2, D=3})
triremesh = TriRemesh(Geometry=conmesh, Length=Slider(7.8, range=0..10), Iterations=25)  # -> Triangulation, Dual, Creases
m_quadr = MeshQuadrangulation(Mesh=triremesh.Triangulation, Sources=Slider(5, range=0..10))
wbcatmullclark = WeaverbirdsCatmullClarkSubdivision(Level=Slider(1, range=0..10), SmoothNakedEdges=0)
